# Dynamo graph print_python_version.dyn (Dynamo 2.18.0.4436)

python_script = Python()  # CPython3; unwired: IN[0]
# ---------- python_script.python (15 lines) ----------
# Load the Python Standard and DesignScript Libraries
import sys
import clr
clr.AddReference('ProtoGeometry')
from Autodesk.DesignScript.Geometry import *

import platform

# The inputs to this node will be stored as a list in the IN variables.
#dataEnteringNode = IN

# Place your code below this line

# Assign your output to the OUT variable.
OUT = "*****************************************************************************************************************************************************************************************************************************************************************************************************************************************************************************************************************************************************************************************************************************************************************************************************************************************************************************************************************************************************************************" + "\n" + sys.version + '\n' + platform.python_implementation()
# ----------------------------------------
watch = Watch(python_script)
python_script_2 = Python()  # IronPython3; unwired: IN[0]; same code as python_script
watch_2 = Watch(python_script_2)
python_script_3 = Python()  # IronPython2; unwired: IN[0]; same code as python_script
watch_3 = Watch(python_script_3)
